# Grasshopper definition spiral_stairs.gh (Grasshopper 1.0.4)

pt = Point(Point(0, 0, 0))
number_slider = Slider(15, range=0..100)
Y = UnitY(Factor=Slider(1, range=0..10))
number_slider_2 = Slider(58, range=0..100)
Y_2 = UnitY(Factor=Slider(4, range=0..10))
move = Move(Geometry=pt, Motion=Y)  # -> Geometry, Transform
move_2 = Move(Geometry=pt, Motion=Y_2)  # -> Geometry, Transform
series = Series(Start=0, Step=number_slider, Count=number_slider_2)
ln = Line(StartPoint=move.Geometry, EndPoint=move_2.Geometry)
Z = UnitZ(Factor=number_slider_2)
rotate = Rotate(Geometry=ln, Angle=degrees(series), Plane=PlaneXY(0, 0, 0))  # -> Geometry, Transform
series_2 = Series(Start=0, Step=Slider(0.2, range=0..1), Count=Z)
Z_2 = UnitZ(Factor=series_2)
move_3 = Move(Geometry=rotate.Geometry, Motion=Z_2)  # -> Geometry, Transform
end = EndPoints(Curve=move_3.Geometry)  # -> Start, End
rotate_2 = Rotate(Geometry=move_3.Geometry, Angle=degrees(number_slider), Plane=pt)  # -> Geometry, Transform
number_slider_3 = Slider(0.3, range=0..1)
intcrv = Interpolate(Vertices=end.End, Degree=3, Periodic=False, KnotStyle=1)  # -> Curve, Length, Domain
intcrv_2 = Interpolate(Vertices=end.Start, Degree=3, Periodic=False, KnotStyle=1)  # -> Curve, Length, Domain
number_slider_4 = Slider(1, range=0..1)
entwine = Entwine(Branch00=move_3.Geometry, Branch01=rotate_2.Geometry, FlattenInputs=True)
flip = FlipMatrix(Data=entwine)
cluster = Cluster(G=intcrv_2.Curve, D=number_slider_3, F=number_slider_4)  # -> L, G_2
loft = Loft(Curves=flip, Options={Adjust=False, Closed=False, LoftEnds=0, LoftSimp=0, LoftType=0, Rebuild=10, Refit=0.01})
cluster_2 = Cluster(G=intcrv.Curve, D=number_slider_3, F=number_slider_4)  # -> L, G_2

# ==== cluster Cluster
D = ClusterInput()
G = ClusterInput()
F = ClusterInput()
divdist = DivideDistance(Curve=G, Distance=D)  # -> Points, Tangents, Parameters
Z = UnitZ(Factor=F)
move = Move(Geometry=G, Motion=Z)  # -> Geometry, Transform
move_2 = Move(Geometry=divdist.Points, Motion=Z)  # -> Geometry, Transform
ln = Line(StartPoint=move_2.Geometry, EndPoint=divdist.Points)
G_2 = ClusterOutput(move.Geometry)
L = ClusterOutput(ln)
