# Grasshopper definition truss_4.gh (Grasshopper 0.9.75)

curve = Curve(<curve referenced from the Rhino model>)
curve_2 = Curve(<curve referenced from the Rhino model>)
curve_3 = Curve(<curve referenced from the Rhino model>)
curve_4 = Curve(<curve referenced from the Rhino model>)
curve_5 = Curve(<curve referenced from the Rhino model>)
curve_6 = Curve(<curve referenced from the Rhino model>)
number_slider = Slider(5, range=1..25)
curve_7 = Curve(<curve referenced from the Rhino model>)
point_on_curve = PointOnCurve(curve_2, parameter=0.751)
point_on_curve_2 = PointOnCurve(curve_2, parameter=0.201)
curve_8 = Curve(<curve referenced from the Rhino model>)
number_slider_2 = Slider(5, range=1..25)
point_on_curve_3 = PointOnCurve(curve_4, parameter=0.751)
point_on_curve_4 = PointOnCurve(curve_4, parameter=0.201)
number_slider_3 = Slider(5, range=1..25)
point_on_curve_5 = PointOnCurve(curve_6, parameter=0.751)
point_on_curve_6 = PointOnCurve(curve_6, parameter=0.201)
curve_closest_point = CurveClosestPoint(Point=[point_on_curve_2, point_on_curve], Curve=curve_2)  # -> Point, Parameter, Distance
number_slider_4 = Slider(5, range=1..25)
point_on_curve_7 = PointOnCurve(curve_8, parameter=0.751)
point_on_curve_8 = PointOnCurve(curve_8, parameter=0.201)
curve_closest_point_2 = CurveClosestPoint(Point=[point_on_curve_4, point_on_curve_3], Curve=curve_4)  # -> Point, Parameter, Distance
curve_closest_point_3 = CurveClosestPoint(Point=[point_on_curve_6, point_on_curve_5], Curve=curve_6)  # -> Point, Parameter, Distance
shatter = Shatter(Curve=curve_2, Parameters=curve_closest_point.Parameter)
curve_closest_point_4 = CurveClosestPoint(Point=[point_on_curve_8, point_on_curve_7], Curve=curve_8)  # -> Point, Parameter, Distance
shatter_2 = Shatter(Curve=curve_4, Parameters=curve_closest_point_2.Parameter)
shatter_3 = Shatter(Curve=curve_6, Parameters=curve_closest_point_3.Parameter)
shatter_4 = Shatter(Curve=curve_8, Parameters=curve_closest_point_4.Parameter)
list_item = ListItem(List=shatter, Index=Slider(0, range=0..2), Wrap=True)
list_item_2 = ListItem(List=shatter, Index=Slider(1, range=0..2), Wrap=True)
list_item_3 = ListItem(List=shatter, Index=Slider(2, range=0..2), Wrap=True)
list_item_4 = ListItem(List=shatter_2, Index=Slider(2, range=0..2), Wrap=True)
list_item_5 = ListItem(List=shatter_2, Index=Slider(0, range=0..2), Wrap=True)
list_item_6 = ListItem(List=shatter_2, Index=Slider(1, range=0..2), Wrap=True)
list_item_7 = ListItem(List=shatter_3, Index=Slider(2, range=0..2), Wrap=True)
list_item_8 = ListItem(List=shatter_3, Index=Slider(0, range=0..2), Wrap=True)
list_item_9 = ListItem(List=shatter_3, Index=Slider(1, range=0..2), Wrap=True)
divide_curve = DivideCurve(Curve=list_item_2, Count=Slider(10, range=1..25), Kinks=False)  # -> Points, Tangents, Parameters
list_item_10 = ListItem(List=shatter_4, Index=Slider(2, range=0..2), Wrap=True)
list_item_11 = ListItem(List=shatter_4, Index=Slider(0, range=0..2), Wrap=True)
list_item_12 = ListItem(List=shatter_4, Index=Slider(1, range=0..2), Wrap=True)
divide_curve_2 = DivideCurve(Curve=list_item_6, Count=Slider(12, range=1..25), Kinks=False)  # -> Points, Tangents, Parameters
divide_curve_3 = DivideCurve(Curve=list_item_9, Count=Slider(12, range=1..25), Kinks=False)  # -> Points, Tangents, Parameters
divide_curve_4 = DivideCurve(Curve=list_item_12, Count=Slider(10, range=1..25), Kinks=False)  # -> Points, Tangents, Parameters
divide_curve_5 = DivideCurve(Curve=list_item, Count=number_slider, Kinks=False)  # -> Points, Tangents, Parameters
divide_curve_6 = DivideCurve(Curve=list_item_3, Count=number_slider, Kinks=False)  # -> Points, Tangents, Parameters
divide_curve_7 = DivideCurve(Curve=list_item_5, Count=number_slider_2, Kinks=False)  # -> Points, Tangents, Parameters
divide_curve_8 = DivideCurve(Curve=list_item_4, Count=number_slider_2, Kinks=False)  # -> Points, Tangents, Parameters
divide_curve_9 = DivideCurve(Curve=list_item_8, Count=number_slider_3, Kinks=False)  # -> Points, Tangents, Parameters
divide_curve_10 = DivideCurve(Curve=list_item_7, Count=number_slider_3, Kinks=False)  # -> Points, Tangents, Parameters
divide_curve_11 = DivideCurve(Curve=list_item_11, Count=number_slider_4, Kinks=False)  # -> Points, Tangents, Parameters
divide_curve_12 = DivideCurve(Curve=list_item_10, Count=number_slider_4, Kinks=False)  # -> Points, Tangents, Parameters
curve_closest_point_5 = CurveClosestPoint(Point=divide_curve_5.Points, Curve=curve)  # -> Point, Parameter, Distance
curve_closest_point_6 = CurveClosestPoint(Point=divide_curve_6.Points, Curve=curve)  # -> Point, Parameter, Distance
curve_closest_point_7 = CurveClosestPoint(Point=divide_curve_7.Points, Curve=curve_3)  # -> Point, Parameter, Distance
curve_closest_point_8 = CurveClosestPoint(Point=divide_curve_8.Points, Curve=curve_3)  # -> Point, Parameter, Distance
curve_closest_point_9 = CurveClosestPoint(Point=divide_curve_9.Points, Curve=curve_5)  # -> Point, Parameter, Distance
curve_closest_point_10 = CurveClosestPoint(Point=divide_curve_10.Points, Curve=curve_5)  # -> Point, Parameter, Distance
shift_list = ShiftList(List=divide_curve.Points, Shift=Slider(-1, range=-10..2), Wrap=False)
shift_list_2 = ShiftList(List=divide_curve.Points, Shift=Slider(1, range=0..2), Wrap=False)
curve_closest_point_11 = CurveClosestPoint(Point=divide_curve_11.Points, Curve=curve_7)  # -> Point, Parameter, Distance
curve_closest_point_12 = CurveClosestPoint(Point=divide_curve_12.Points, Curve=curve_7)  # -> Point, Parameter, Distance
shift_list_3 = ShiftList(List=divide_curve_2.Points, Shift=Slider(-1, range=-10..2), Wrap=False)
shift_list_4 = ShiftList(List=divide_curve_2.Points, Shift=Slider(1, range=0..2), Wrap=False)
shift_list_5 = ShiftList(List=divide_curve_3.Points, Shift=Slider(-1, range=-10..2), Wrap=False)
shift_list_6 = ShiftList(List=divide_curve_3.Points, Shift=Slider(1, range=0..2), Wrap=False)
line = Line(StartPoint=shift_list, EndPoint=shift_list_2)
number_slider_5 = Slider(1, range=0..2)
point_on_curve_9 = PointOnCurve(line, parameter=0.5)
shift_list_7 = ShiftList(List=divide_curve_4.Points, Shift=Slider(-1, range=-10..2), Wrap=False)
shift_list_8 = ShiftList(List=divide_curve_4.Points, Shift=Slider(1, range=0..2), Wrap=False)
line_2 = Line(StartPoint=shift_list_3, EndPoint=shift_list_4)
number_slider_6 = Slider(1, range=0..2)
line_3 = Line(StartPoint=shift_list_5, EndPoint=shift_list_6)
number_slider_7 = Slider(1, range=0..2)
point_on_curve_10 = PointOnCurve(line_2, parameter=0.5)
point_on_curve_11 = PointOnCurve(line_3, parameter=0.5)
line_4 = Line(StartPoint=shift_list_7, EndPoint=shift_list_8)
curve_closest_point_13 = CurveClosestPoint(Point=point_on_curve_9, Curve=curve)  # -> Point, Parameter, Distance
number_slider_8 = Slider(1, range=0..2)
point_on_curve_12 = PointOnCurve(line_4, parameter=0.5)
curve_closest_point_14 = CurveClosestPoint(Point=point_on_curve_10, Curve=curve_3)  # -> Point, Parameter, Distance
shift_list_9 = ShiftList(List=divide_curve_5.Points, Shift=Slider(1, range=-2..2), Wrap=False)
shift_list_10 = ShiftList(List=curve_closest_point_6.Point, Shift=number_slider_5, Wrap=False)
shift_list_11 = ShiftList(List=curve_closest_point_5.Point, Shift=Slider(-1, range=-2..2), Wrap=False)
shift_list_12 = ShiftList(List=divide_curve_6.Points, Shift=number_slider_5, Wrap=False)
curve_closest_point_15 = CurveClosestPoint(Point=point_on_curve_11, Curve=curve_5)  # -> Point, Parameter, Distance
shift_list_13 = ShiftList(List=divide_curve_7.Points, Shift=Slider(1, range=-2..2), Wrap=False)
shift_list_14 = ShiftList(List=curve_closest_point_8.Point, Shift=number_slider_6, Wrap=False)
shift_list_15 = ShiftList(List=curve_closest_point_7.Point, Shift=Slider(-1, range=-2..2), Wrap=False)
shift_list_16 = ShiftList(List=divide_curve_8.Points, Shift=number_slider_6, Wrap=False)
curve_closest_point_16 = CurveClosestPoint(Point=point_on_curve_12, Curve=curve_7)  # -> Point, Parameter, Distance
shift_list_17 = ShiftList(List=divide_curve_9.Points, Shift=Slider(1, range=-2..2), Wrap=False)
shift_list_18 = ShiftList(List=curve_closest_point_10.Point, Shift=number_slider_7, Wrap=False)
shift_list_19 = ShiftList(List=curve_closest_point_9.Point, Shift=Slider(-1, range=-2..2), Wrap=False)
shift_list_20 = ShiftList(List=divide_curve_10.Points, Shift=number_slider_7, Wrap=False)
line_5 = Line(StartPoint=shift_list_9, EndPoint=shift_list_11)
line_6 = Line(StartPoint=shift_list_12, EndPoint=shift_list_10)
line_7 = Line(StartPoint=shift_list, EndPoint=curve_closest_point_13.Point)
line_8 = Line(StartPoint=shift_list_2, EndPoint=curve_closest_point_13.Point)
shift_list_21 = ShiftList(List=divide_curve_11.Points, Shift=Slider(1, range=-2..2), Wrap=False)
shift_list_22 = ShiftList(List=curve_closest_point_12.Point, Shift=number_slider_8, Wrap=False)
shift_list_23 = ShiftList(List=curve_closest_point_11.Point, Shift=Slider(-1, range=-2..2), Wrap=False)
shift_list_24 = ShiftList(List=divide_curve_12.Points, Shift=number_slider_8, Wrap=False)
line_9 = Line(StartPoint=shift_list_13, EndPoint=shift_list_15)
line_10 = Line(StartPoint=shift_list_16, EndPoint=shift_list_14)
line_11 = Line(StartPoint=shift_list_17, EndPoint=shift_list_19)
line_12 = Line(StartPoint=shift_list_20, EndPoint=shift_list_18)
line_13 = Line(StartPoint=shift_list_3, EndPoint=curve_closest_point_14.Point)
line_14 = Line(StartPoint=shift_list_4, EndPoint=curve_closest_point_14.Point)
line_15 = Line(StartPoint=shift_list_6, EndPoint=curve_closest_point_15.Point)
line_16 = Line(StartPoint=shift_list_5, EndPoint=curve_closest_point_15.Point)
line_17 = Line(StartPoint=shift_list_21, EndPoint=shift_list_23)
line_18 = Line(StartPoint=shift_list_24, EndPoint=shift_list_22)
line_19 = Line(StartPoint=shift_list_7, EndPoint=curve_closest_point_16.Point)
line_20 = Line(StartPoint=shift_list_8, EndPoint=curve_closest_point_16.Point)
pipe = Pipe(Curve=[line_8, line_6, line_7, line_5], Radius=Slider(0.25, range=0..1), Caps=0)
pipe_2 = Pipe(Curve=[curve_2, curve], Radius=Slider(1, range=0..1), Caps=0)
pipe_3 = Pipe(Curve=[line_14, line_10, line_13, line_9], Radius=Slider(0.25, range=0..1), Caps=0)
pipe_4 = Pipe(Curve=[curve_4, curve_3], Radius=Slider(1, range=0..1), Caps=0)
pipe_5 = Pipe(Curve=[line_15, line_12, line_16, line_11], Radius=Slider(0.25, range=0..1), Caps=0)
pipe_6 = Pipe(Curve=[curve_6, curve_5], Radius=Slider(1, range=0..1), Caps=0)
pipe_7 = Pipe(Curve=[line_20, line_18, line_19, line_17], Radius=Slider(0.25, range=0..1), Caps=0)
pipe_8 = Pipe(Curve=[curve_8, curve_7], Radius=Slider(1, range=0..1), Caps=0)
