# Grasshopper definition stairs.gh (Grasshopper 0.9.75)

curve = Curve(<curve referenced from the Rhino model>)
curve_2 = Curve(<curve referenced from the Rhino model>)
unit_z = UnitZ(Factor=Slider(13.12, range=0..20))

end_points = EndPoints(Curve=curve_2)  # -> Start, End
move = Move(Geometry=end_points.End, Motion=unit_z)  # -> Geometry, Transform
unit_z_2 = UnitZ(Factor=Slider(10.8, range=0..200))
unit_x = UnitX(Factor=unit_z_2)
line = Line(StartPoint=end_points.Start, EndPoint=move.Geometry)
extrude = Extrude(Base=line, Direction=unit_x)

number_slider = Slider(19, range=0..100)
curve_3 = Curve(<curve referenced from the Rhino model>)
curve_4 = Curve(<curve referenced from the Rhino model>)
divide_curve = DivideCurve(Curve=curve_3, Count=number_slider, Kinks=False)  # -> Points, Tangents, Parameters
divide_curve_2 = DivideCurve(Curve=curve_4, Count=number_slider, Kinks=False)  # -> Points, Tangents, Parameters
number_slider_2 = Slider(46, range=0..100)
multiplication = Multiplication(A=unit_x, B="-1/2")
move_2 = Move(Geometry=extrude, Motion=multiplication)  # -> Geometry, Transform
line_2 = Line(StartPoint=divide_curve.Points, EndPoint=divide_curve_2.Points)

extrude_2 = Extrude(Base=curve, Direction=unit_z)
extrude_3 = Extrude(Base=curve_2, Direction=unit_z)
brep_brep = BrepBrep(BrepA=move_2.Geometry, BrepB=extrude_2)  # -> Curves, Points
brep_brep_2 = BrepBrep(BrepA=move_2.Geometry, BrepB=extrude_3)  # -> Curves, Points
divide_curve_3 = DivideCurve(Curve=brep_brep.Curves, Count=number_slider_2, Kinks=False)  # -> Points, Tangents, Parameters
divide_curve_4 = DivideCurve(Curve=brep_brep_2.Curves, Count=number_slider_2, Kinks=False)  # -> Points, Tangents, Parameters
line_3 = Line(StartPoint=divide_curve_3.Points, EndPoint=divide_curve_4.Points)

length = Length(Curve=curve_2)
division = Division(A=length, B=number_slider_2)
xz_plane = XZPlane(Origin=Point(0, 0, 0))
extrude_4 = Extrude(Base=line_3, Direction=xz_plane)
