# Grasshopper definition truss_cluster.gh (Grasshopper 0.9.75)

curve = Curve(<curve referenced from the Rhino model>)
curve_2 = Curve(<curve referenced from the Rhino model>)

point_on_curve = PointOnCurve(curve_2, parameter=0.752)
point_on_curve_2 = PointOnCurve(curve_2, parameter=0.201)
curve_closest_point = CurveClosestPoint(Point=[point_on_curve_2, point_on_curve], Curve=curve_2)  # -> Point, Parameter, Distance
shatter = Shatter(Curve=curve_2, Parameters=curve_closest_point.Parameter)

list_item = ListItem(List=shatter, Index=Slider(0, range=0..2), Wrap=True)
list_item_2 = ListItem(List=shatter, Index=Slider(1, range=0..2), Wrap=True)
list_item_3 = ListItem(List=shatter, Index=Slider(2, range=0..2), Wrap=True)

divide_curve = DivideCurve(Curve=list_item, Count=Slider(5, range=1..25), Kinks=False)  # -> Points, Tangents, Parameters
curve_closest_point_2 = CurveClosestPoint(Point=divide_curve.Points, Curve=curve)  # -> Point, Parameter, Distance
shift_list = ShiftList(List=divide_curve.Points, Shift=Slider(1, range=-2..2), Wrap=False)
shift_list_2 = ShiftList(List=curve_closest_point_2.Point, Shift=Slider(-1, range=-2..2), Wrap=False)
line = Line(StartPoint=shift_list, EndPoint=shift_list_2)

divide_curve_2 = DivideCurve(Curve=list_item_2, Count=Slider(11, range=1..25), Kinks=False)  # -> Points, Tangents, Parameters
shift_list_3 = ShiftList(List=divide_curve_2.Points, Shift=Slider(-1, range=-10..2), Wrap=False)
shift_list_4 = ShiftList(List=divide_curve_2.Points, Shift=Slider(1, range=0..2), Wrap=False)
line_2 = Line(StartPoint=shift_list_3, EndPoint=shift_list_4)
point_on_curve_3 = PointOnCurve(line_2, parameter=0.5)
curve_closest_point_3 = CurveClosestPoint(Point=point_on_curve_3, Curve=curve)  # -> Point, Parameter, Distance
line_3 = Line(StartPoint=shift_list_3, EndPoint=curve_closest_point_3.Point)
line_4 = Line(StartPoint=shift_list_4, EndPoint=curve_closest_point_3.Point)

divide_curve_3 = DivideCurve(Curve=list_item_3, Count=Slider(5, range=1..25), Kinks=False)  # -> Points, Tangents, Parameters
curve_closest_point_4 = CurveClosestPoint(Point=divide_curve_3.Points, Curve=curve)  # -> Point, Parameter, Distance
shift_list_5 = ShiftList(List=divide_curve_3.Points, Shift=Slider(1, range=-2..2), Wrap=False)
shift_list_6 = ShiftList(List=curve_closest_point_4.Point, Shift=Slider(-1, range=-2..2), Wrap=False)
line_5 = Line(StartPoint=shift_list_5, EndPoint=shift_list_6)

pipe = Pipe(Curve=[line_5, line_3, line_4, line], Radius=Slider(0.25, range=0..1), Caps=0)
pipe_2 = Pipe(Curve=[curve_2, curve], Radius=Slider(1, range=0..1), Caps=0)
