# Grasshopper definition trees.gh (Grasshopper 0.9.75)

crv = Curve(<curve referenced from the Rhino model>)
area = Area(Geometry=crv)  # -> Area, Centroid
incurve = PointInCurve()  # -> Relationship, Point
sqgrid = Square(Plane=area.Centroid, Size=Slider(50, range=0..50), ExtentX=Slider(120, range=0..120), ExtentY=Slider(104, range=0..120))  # -> Cells, Points
pt = PointPolar(BasePlane=PlaneXY(0, 0, 0), XYAngle=0, ZAngle=0, Offset=1)
dom = ConstructDomain(DomainStart=Slider(28, range=0..30), DomainEnd=Slider(46, range=0..50))
crv_2 = Curve(<curve referenced from the Rhino model>)
incurve_2 = PointInCurve(Point=sqgrid.Points, Curve=crv_2)  # -> Relationship, Point
division = Division(A=incurve_2.Relationship, B=2)
round = Round(Number=division)  # -> Nearest, Floor, Ceiling
dispatch = Dispatch(List=sqgrid.Points, DispatchPattern=round.Floor)  # -> ListA, ListB
pt_2 = Point(flatten(dispatch.ListA))
# Hover over to see how many points there are
lng = ListLength(List=pt_2)
reduce = RandomReduce(List=pt_2, Reduction=Slider(3, range=0..2316), Seed=1)
lng_2 = ListLength(List=reduce)
range = Range(Domain=dom, Steps=lng_2)
graph = GraphMapper(
    range,
    x0=0,
    x1=1,
    y0=0,
    y1=1,
    container_name="Parabola",
    Ox=0.3403709531,
    Oy=0.2530946732,
    Px=0.7654047608,
    Py=0.2578434348)
circle = CircleCNR(Center=reduce, Normal=Vector(0, 0, 1), Radius=graph)
